# Dynamo custom node AddItemFrontof String.dyf (Dynamo 1.3.0.875)
# category: ProjectFrog

code_block = CodeBlock { "_"; }
code_block_2 = CodeBlock { "Simple_version"; }
ModelName = Input()
code_block_3 = CodeBlock(name=ModelName) { name; }
create = List.Create(code_block_2, code_block_3)
join = String.Join(code_block, create)
StandardName = Output(join)
