# Dynamo graph Create Lev_100 Model.dyn (Dynamo 1.3.0.875)

# group: UI FORM
code_block = CodeBlock { "MODEL PARAINFO EXTRACTION AND LEV_100 MODEL RECONSTRUCTION"; }
file_path = Filename(".\Logo.PNG")
fromPath = FileObject(file_path)  # "File.FromPath"
readFromFile = Image.ReadFromFile(fromPath)
code_block_2 = CodeBlock { "GENERATE TEMPLATE AND .JSON FILE"; }
code_block_3 = CodeBlock { "PANEL TYPE"; }
categories = Categories("GenericModel")
all_family_types_of_category = Custom[All Family Types Of Category](category=categories)  # Gets all family types/symbols of a given category in the model (does *not *work for system families)
count = Count(all_family_types_of_category)
code_block_4 = CodeBlock(list=count) { 0..list-1..1; }
boolean = BoolSelector(true)
ui_listview_data = Custom[UI.Listview Data](InputName=code_block_3, Keys=all_family_types_of_category, Values=code_block_4, HighlightInView_optionnal=boolean, ShowElementCount_optionnal=boolean)  # Create data for ListView input in UI.MultiInputForm ++ . Check out www.data-shapes.net for more infos.
boolean_2 = BoolSelector(true)
code_block_5 = CodeBlock { "http://projectfrog.com/"; }
code_block_6 = CodeBlock { 440; }
ui_multipleinputform = Custom[UI.MultipleInputForm ++](Description_optional=code_block, Logo_optional=readFromFile, ButtonText_optional=code_block_2, Inputs=ui_listview_data, Toggle=boolean_2, LinkToHelp_optional=code_block_5, Width_optional=code_block_6)  # Create a form with multiple inputs. see www.data-shapes.net for tutorials and infos!
watch = Watch(ui_multipleinputform.User_Inputs)
getItemAtIndex = List.GetItemAtIndex(list=all_family_types_of_category)  # unwired: index
map = List.Map(list=watch, f_x=getItemAtIndex)
flatten = Flatten(map)
watch_image = WatchImageCore(readFromFile)

# group: Step 1: Extract para_info from model
extractPanelPara = Custom[ExtractPanelPara]()  # unwired: wallpanelType

map_2 = List.Map(list=flatten, f_x=extractPanelPara.paraValue)

# group: Step 3: Create model using a new family type : "simple_version_X" and save as .rfa file
createGeneralPanel = Custom[CreateGeneralPanel]()  # unwired: list

map_3 = List.Map(list=map_2, f_x=createGeneralPanel)

# group: Step 2: Write the para_info to JSON file
writeToJSON = Custom[WriteToJSON]()  # unwired: list

map_4 = List.Map(list=map_2, f_x=writeToJSON)
