# Dynamo custom node CreateNotch.dyf "createVoid" (Dynamo 1.3.0.875)
# category: ProjectFrog

BASEMODEL = Input()
NOTCH_HEIGHT = Input()
NOTCH_THICKNESS = Input()
PANEL_HEIGHT = Input()
NOTCHWIDTH = Input()

# group: Create Notch
code_block = CodeBlock { 0; }
byCoordinates = Point.ByCoordinates(x=code_block, y=code_block, z=NOTCH_HEIGHT)
byCoordinates_2 = Point.ByCoordinates(x=code_block, y=NOTCH_THICKNESS, z=NOTCH_HEIGHT)
byCoordinates_3 = Point.ByCoordinates(x=code_block, y=NOTCH_THICKNESS, z=PANEL_HEIGHT)
byCoordinates_4 = Point.ByCoordinates(x=code_block, y=code_block, z=PANEL_HEIGHT)
create = List.Create(byCoordinates, byCoordinates_2, byCoordinates_3, byCoordinates_4)
byCornerPoints = Rectangle.ByCornerPoints(create)
XAxis = Vector.XAxis()
translate = Geometry.Translate(geometry=byCornerPoints, direction=XAxis, distance=NOTCHWIDTH)
create_2 = List.Create(byCornerPoints, translate)
byLoft = Solid.ByLoft(create_2)

difference = Solid.Difference(solid=BASEMODEL, other=byLoft)
Solid = Output(difference)
