# Dynamo custom node CreateSimplePanel.dyf "CreateGeneralPanel" (Dynamo 1.3.0.875)
# category: ProjectFrog

list = Input()

# group: Create Solid Model Subtract Notch
code_block = CodeBlock(list=list) { list[0]; list[1]; list[2]; list[3]; list[4]; list[5]; list[6]; }
createSolidwall = Custom[createSolidwall](WIDTH=code_block.out3, HEIGHT=code_block.out1, LENGTH=code_block.out0, PITCH=code_block.out2)
createVoid = Custom[createVoid](NOTCH_HEIGHT=code_block.out4, NOTCH_THICKNESS=code_block.out3, PANEL_HEIGHT=code_block.out1, NOTCHWIDTH=code_block.out5, BASEMODEL=createSolidwall)
code_block_2 = CodeBlock(NOTCH_HEIGHT=code_block.out4, HEIGHT=code_block.out1) { NOTCH_HEIGHT==HEIGHT; }
if_ = If(test=code_block_2, true=createSolidwall, false=createVoid)

watch = Watch(createVoid)

# group: Alternative 2: Create DirectShape
categories = Categories("GenericModel")
code_block_3 = CodeBlock { "OSB"; }
byName = Material.ByName(code_block_3)
byGeometry = DirectShape.ByGeometry(category=categories, material=byName, name=code_block.out6)  # unwired: geometry
watch_2 = Watch(byGeometry)

watch_3 = Watch(createSolidwall)
watch_4 = Watch(list)
watch_5 = Watch(if_)

# group: Alternative 1: Create Family Type
code_block_4 = CodeBlock { "_"; }
code_block_5 = CodeBlock { "Simple_version"; }
create = List.Create(code_block_5, code_block.out6)
join = String.Join(code_block_4, create)
categories_2 = Categories("GenericModel")
file_path = Filename("..\ProgramData\Autodesk\RVT 2017\Family Templates\English\Metric Generic Model.rft")
code_block_6 = CodeBlock { "OSB"; }
byName_2 = Material.ByName(code_block_6)
byGeometry_2 = FamilyType.ByGeometry(solidGeometry=if_, name=join, category=categories_2, templatePath=file_path, material=byName_2)
origin = Point.Origin()
byPoint = FamilyInstance.ByPoint(familyType=byGeometry_2, point=origin)
type = FamilyInstance.Type(byPoint)
name = FamilyType.Name(type)
flatten = Flatten(name)
# note: Step 4: Save the model as .rfa file
saveModeltoRFAfile = Custom[SaveModeltoRFAfile]()  # unwired: ModelName
map = List.Map(list=flatten, f_x=saveModeltoRFAfile)

watch_6 = Watch(byGeometry_2)
NULL = Output(map)
