# Dynamo custom node CreateSolidWall.dyf "createSolidwall" (Dynamo 1.3.0.875)
# category: ProjectFrog

WIDTH = Input()
HEIGHT = Input()

# group: Create Low Side Rect
origin = Point.Origin()
code_block = CodeBlock { 0; }
byCoordinates = Point.ByCoordinates(x=code_block, y=WIDTH, z=code_block)
byCoordinates_2 = Point.ByCoordinates(x=code_block, y=WIDTH, z=HEIGHT)
byCoordinates_3 = Point.ByCoordinates(x=code_block, y=code_block, z=HEIGHT)
create = List.Create(origin, byCoordinates, byCoordinates_2, byCoordinates_3)
byCornerPoints = Rectangle.ByCornerPoints(create)

LENGTH = Input()
PITCH = Input()

# group: Create High Side Rect
code_block_2 = CodeBlock { 0; }
byCoordinates_4 = Point.ByCoordinates(x=LENGTH, y=code_block_2, z=code_block_2)
byCoordinates_5 = Point.ByCoordinates(x=LENGTH, y=WIDTH, z=code_block_2)
code_block_3 = CodeBlock(height=HEIGHT, slope=PITCH, length=LENGTH) { height+slope*length; }
byCoordinates_6 = Point.ByCoordinates(x=LENGTH, y=WIDTH, z=code_block_3)
byCoordinates_7 = Point.ByCoordinates(x=LENGTH, y=code_block_2, z=code_block_3)
create_2 = List.Create(byCoordinates_4, byCoordinates_5, byCoordinates_6, byCoordinates_7)
byCornerPoints_2 = Rectangle.ByCornerPoints(create_2)

create_3 = List.Create(byCornerPoints, byCornerPoints_2)
byLoft = Solid.ByLoft(create_3)
Solidwall = Output(byLoft)
