# Dynamo custom node ExtractPanelPara.dyf (Dynamo 1.3.0.875)
# category: ProjectFrog

wallpanelType = Input()

# group: GET THE WALL TYPE PARAMETER
code_block = CodeBlock { "PANEL LENGTH"; }
getParameterValueByName = Element.GetParameterValueByName(element=wallpanelType, parameterName=code_block)
code_block_2 = CodeBlock { "PANEL HEIGHT"; }
getParameterValueByName_2 = Element.GetParameterValueByName(element=wallpanelType, parameterName=code_block_2)
code_block_3 = CodeBlock { "PANEL PITCH PER FOOT"; }
getParameterValueByName_3 = Element.GetParameterValueByName(element=wallpanelType, parameterName=code_block_3)
code_block_4 = CodeBlock { "SHEATHING BACK ON OFF"; }
getParameterValueByName_4 = Element.GetParameterValueByName(element=wallpanelType, parameterName=code_block_4)
code_block_5 = CodeBlock { "SHEATHING FRONT ON OFF"; }
getParameterValueByName_5 = Element.GetParameterValueByName(element=wallpanelType, parameterName=code_block_5)
code_block_6 = CodeBlock { "SHEATHING THICKNESS"; }
getParameterValueByName_6 = Element.GetParameterValueByName(element=wallpanelType, parameterName=code_block_6)
code_block_7 = CodeBlock { "PLATE BOTTOM WIDTH"; }
getParameterValueByName_7 = Element.GetParameterValueByName(element=wallpanelType, parameterName=code_block_7)
code_block_8 = CodeBlock { "STUD SIZE 01"; }
getParameterValueByName_8 = Element.GetParameterValueByName(element=wallpanelType, parameterName=code_block_8)
code_block_9 = CodeBlock { "Type Name"; }
getParameterValueByName_9 = Element.GetParameterValueByName(element=wallpanelType, parameterName=code_block_9)

# group: CALCULATE THE PANEL WIDTH
watch = Watch(getParameterValueByName_4)
code_block_10 = CodeBlock(value=watch) { value==1; }
watch_2 = Watch(getParameterValueByName_5)
code_block_11 = CodeBlock(value=watch_2) { value==1; }
add = getParameterValueByName_6 + getParameterValueByName_7
if_ = If(test=code_block_11, true=add, false=getParameterValueByName_7)
add_2 = if_ + getParameterValueByName_6
if_2 = If(test=code_block_10, true=add_2, false=if_)
watch_3 = Watch(if_2)
watch_4 = Watch(if_)

# group: CHANGE THE UNIT
code_block_12 = CodeBlock { ":"; }
feet2Fraction = Custom[Springs.Feet2Fraction](number=getParameterValueByName)  # Converts a decimal foot value to a fractional foot/inch string.
string_from_object = FromObject(feet2Fraction)
create = List.Create(code_block, string_from_object)
join = String.Join(code_block_12, create)
code_block_13 = CodeBlock { ":"; }
feet2Fraction_2 = Custom[Springs.Feet2Fraction](number=getParameterValueByName_2)
string_from_object_2 = FromObject(feet2Fraction_2)
create_2 = List.Create(code_block_2, string_from_object_2)
join_2 = String.Join(code_block_13, create_2)
code_block_14 = CodeBlock { ":"; }
feet2Fraction_3 = Custom[Springs.Feet2Fraction](number=getParameterValueByName_3)
string_from_object_3 = FromObject(feet2Fraction_3)
create_3 = List.Create(code_block_3, string_from_object_3)
join_3 = String.Join(code_block_14, create_3)
code_block_15 = CodeBlock { ":"; }
code_block_16 = CodeBlock { "PANEL THICKNESS"; }
feet2Fraction_4 = Custom[Springs.Feet2Fraction](number=watch_3)
string_from_object_4 = FromObject(feet2Fraction_4)
create_4 = List.Create(code_block_16, string_from_object_4)
join_4 = String.Join(code_block_15, create_4)
code_block_17 = CodeBlock { ":"; }
code_block_18 = CodeBlock { "NOTCH WIDTH"; }
feet2Fraction_5 = Custom[Springs.Feet2Fraction](number=getParameterValueByName_8)
string_from_object_5 = FromObject(feet2Fraction_5)
create_5 = List.Create(code_block_18, string_from_object_5)
join_5 = String.Join(code_block_17, create_5)
code_block_19 = CodeBlock { ":"; }
code_block_20 = CodeBlock { "TYPE NAME"; }
create_6 = List.Create(code_block_20, getParameterValueByName_9)
join_6 = String.Join(code_block_19, create_6)

# group: NOTCH OFFSET (UNFINISHED)
code_block_21 = CodeBlock { ":"; }
code_block_22 = CodeBlock { "NOTCH HEIGHT"; }
code_block_23 = CodeBlock { notchOffset(); }
sub = getParameterValueByName_2 - code_block_23
string_from_object_6 = FromObject(sub)
create_7 = List.Create(code_block_22, string_from_object_6)
join_7 = String.Join(code_block_21, create_7)

# group: Checklist
create_8 = List.Create(join, join_2, join_3, join_4, join_7, join_5, join_6)
watch_5 = Watch(create_8)
create_9 = List.Create(getParameterValueByName, getParameterValueByName_2, getParameterValueByName_3, watch_3, sub, getParameterValueByName_8, getParameterValueByName_9)
watch_6 = Watch(create_9)

flatten = Flatten(watch_5)
wallPanelpara = Output(flatten)
paraValue = Output(create_9)

# group: DEFINE NOTCH OFFSET
code_block_24 = CodeBlock { def notchOffset() {return =1.5; }; }

# group: DEFINE PITCH PER FOOT
code_block_25 = CodeBlock { def Pitch() {return =0; }; }

watch_7 = Watch(sub)
