# Dynamo custom node SaveModeltoRFAfile.dyf (Dynamo 1.3.0.875)
# category: ProjectFrog

element_types = ElementTypes("Family")
all_elements_of_type = ElementsOfType(element_types)
name = Family.Name(all_elements_of_type)
ModelName = Input()
endsWith = String.EndsWith(name, ModelName)
filterByBoolMask = List.FilterByBoolMask(list=all_elements_of_type, mask=endsWith)
watch = Watch(filterByBoolMask.in)
code_block = CodeBlock()
# ---------- code_block.designscript (27 lines) ----------
"
import clr
clr.AddReference('ProtoGeometry')
from Autodesk.DesignScript.Geometry import *
clr.AddReference('RevitAPI')
import Autodesk
clr.AddReference('RevitServices')
import RevitServices
from RevitServices.Persistence import DocumentManager
from RevitServices.Transactions import TransactionManager
doc = DocumentManager.Instance.CurrentDBDocument
#Close all transactions
trans = TransactionManager.Instance
trans.ForceCloseTransaction()
fams = IN[0]
paths = IN[1]
#unwrap the Dynamo elements
fams = map(UnwrapElement, fams)
for i in xrange(len(fams) ):

    famDoc = doc.EditFamily(fams[i])

    famDoc.SaveAs(paths[i])

    famDoc.Close(False)
OUT = 0
";
# ----------------------------------------
directory_path = Directory("X:\Users\Kemp\python")
name_2 = Family.Name(filterByBoolMask.in)
code_block_2 = CodeBlock(dir=directory_path, name=name_2) { dir+"\\"+name+".rfa"; }
python_script_from_string = PythonStringNode(script=code_block, IN[0]=filterByBoolMask.in, IN[1]=code_block_2)
OUT = Output(python_script_from_string)
watch_2 = Watch(name)
watch_3 = Watch(ModelName)
watch_4 = Watch(name_2)
watch_5 = Watch(code_block_2)
