# Dynamo graph SelectItemtoCreateModel.dyn (Dynamo 1.3.0.875)

# group: UI FORM
code_block = CodeBlock { "FamilyType"; }
code_block_2 = CodeBlock { "se"; }
boolean = BoolSelector(true)
multipleInputForm = Custom[UI.MultipleInputForm](InputNames=code_block, InputTypes_see_description=code_block_2, Toggle=boolean)  # Create a form with multiple inputs. InputType codification: -strings : "s" -booleans : "bool" -filepaths : "fp" -directorypath : "dp" -revit element section : "se" -revit face selection : "sf" -revit edge selection : "sed" -dropdown lists : UI.DropDown Data node -listview : UI.ListView Data node see www.data-shapes.net for more infos
type = FamilyInstance.Type(multipleInputForm.User_inputs)
flatten = Flatten(type)

# group: Step 1: Extract para_info from model
extractPanelPara = Custom[ExtractPanelPara]()  # unwired: wallpanelType

map = List.Map(list=flatten, f_x=extractPanelPara.paraValue)

# group: Step 2: Write the para_info to JSON file
writeToJSON = Custom[WriteToJSON]()  # unwired: list

map_2 = List.Map(list=map, f_x=writeToJSON)

# group: Step 3: Create model using a new family type : "simple_version_X" and save as .rfa file
createGeneralPanel = Custom[CreateGeneralPanel]()  # unwired: list

map_3 = List.Map(list=map, f_x=createGeneralPanel)
