# Dynamo custom node WriteToJSON.dyf (Dynamo 1.3.0.875)
# category: ProjectFrog

list = Input()  # "list[]"
code_block = CodeBlock(datalist=list) { datalist[0]; datalist[1]; datalist[2]; datalist[3]; datalist[4]; datalist[5]; datalist[6]; }
python_script = Python(IN[0]=code_block.out0, IN[1]=code_block.out1, IN[2]=code_block.out2, IN[3]=code_block.out3, IN[4]=code_block.out4, IN[5]=code_block.out5, IN[6]=code_block.out6)
# ---------- python_script.python (30 lines) ----------
import sys
sys.path.append('C:\Program Files (x86)\IronPython 2.7\Lib')
import json
import os.path
#The inputs to this node will be stored as a list in the IN variables.
#IN=[8,12,0.125,0.65625,10.5,0.4583,"A002"]
PANEL_LENGTH= IN[0]
PANEL_HEIGHT=IN[1]
PANEL_PITCH_PER_FOOT=IN[2]
PANEL_THICKNESS=IN[3]
NOTCH_HEIGHT=IN[4]
NOTCH_WIDTH=IN[5]
PANEL_TYPE=IN[6]
data={
    "PANEL TYPE":PANEL_TYPE,
    "PANEL LENGTH":PANEL_LENGTH,
    "PANEL HEIGHT":PANEL_HEIGHT,
    "PANEL PITCH PER FOOT":PANEL_PITCH_PER_FOOT,
    "PANEL THICKNESS":PANEL_THICKNESS,
    "NOTCH HEIGHT":NOTCH_HEIGHT,
    "NOTCH WIDTH":NOTCH_WIDTH
}
jsonData=json.dumps(data)
print(jsonData)
filepath=os.path.join('X:\\Users\\Kemp\\python',PANEL_TYPE)
with open(filepath + '.json','w') as f:
     f.write(jsonData)

#Assign your output to the OUT variable.
OUT=0
# ----------------------------------------
OUT = Output(python_script)
watch = Watch(list)
